# Dynamo custom node InsertBlockReferenceToBlock.dyf (Dynamo 2.12.1.8246)
# category: DynNCAD.DynNCAD.Objects.AcadBlockReference
# Python-нод для создания вхождения блока  (BlockReference) в данное пространство Блока. Результат подавать на вход одному из конструктору класса BlockReference

block_to_insert = Input(block_to_insert: var)
blocks_name = Input(blocks_name: string)
insertion_point = Input(insertion_point: var)
scale_x = Input(scale_x: double)
scale_y = Input(scale_y: double)
scale_z = Input(scale_z: double)
rotation = Input(rotation: double)
operation = Python(IN[0]=block_to_insert, IN[1]=blocks_name, IN[2]=insertion_point, IN[3]=scale_x, IN[4]=scale_y, IN[5]=scale_z, IN[6]=rotation)  # IronPython2
# ---------- operation.python (16 lines) ----------
"""
Входные параметры для создания Вхождения блока
COM-функция AcadBlock.InsertBlock()

"""
block_to_insert = IN[0]
block_parent_name = IN[1]
block_ref_insertion_point = IN[2]
block_ref_scale_x = IN[3]
block_ref_scale_y = IN[4]
block_ref_scale_z = IN[5]
block_ref_rotation = IN[6]

block_ref_insertion_point_str = str(block_ref_insertion_point.X) + "," + str(block_ref_insertion_point.Y) + "," + str(block_ref_insertion_point.Z)
created_block_ref = block_to_insert._i.InsertBlock(block_ref_insertion_point_str, block_parent_name, block_ref_scale_x, block_ref_scale_y, block_ref_scale_z, block_ref_rotation)
OUT = created_block_ref
# ----------------------------------------
acadBlockReference = DynNCAD.Objects.AcadBlockReference.AcadBlockReference(AcadBlockReference=operation)  # graph output
