# Dynamo graph GetBlocks.dyn (Dynamo 2.12.1.8246)

application = DynNCAD.Project.Application.Application()
NDocument = DynNCAD.Project.NDocument.NDocument(ncad_app=application)
blocks = DynNCAD.Project.NDocument.Blocks(nDocument=NDocument)
name = DynNCAD.Project.Block.Name(block=blocks)
layouts_AsBlocks = DynNCAD.Project.NDocument.Layouts_AsBlocks(nDocument=NDocument)
name_2 = DynNCAD.Project.Block.Name(block=layouts_AsBlocks)
modelSpace = DynNCAD.Project.NDocument.ModelSpace(nDocument=NDocument)
name_3 = DynNCAD.Project.Block.Name(block=modelSpace)
