# Dynamo graph GetLayers.dyn (Dynamo 2.12.0.5650)

currentDoc = nanoCAD.Init.CurrentDoc()
layers = nanoCAD.DynDocument.Property.Layers(aux=currentDoc)  # frozen
collectionToLayers = nanoCAD.DynLayer.Methods.CollectionToLayers(com_layer_collection=layers)  # frozen; unwired: aux
getLayerInfo = nanoCAD.DynLayer.Methods.GetLayerInfo(aux=collectionToLayers)  # frozen; unwired: com_layer
code_block = CodeBlock { "OurNewLayer"; }
newLayerByName = nanoCAD.DynLayer.Methods.NewLayerByName(aux=currentDoc, new_layer_name=code_block)
getLayerByName = nanoCAD.DynLayer.Methods.GetLayerByName(aux=newLayerByName, layer_name=code_block)
editLayer = nanoCAD.DynLayer.Methods.EditLayer(aux=newLayerByName, com_layer=getLayerByName)  # unwired: layer_LayerOn, layer_LineType, layer_lock, layer_material, layer_name, layer_PlotStyleName, com_AcadAcCmColor
