# Dynamo graph InsertText.dyn (Dynamo 2.12.1.8246)

application = DynNCAD.Project.Application.Application()
NDocument = DynNCAD.Project.NDocument.NDocument(ncad_app=application)
modelSpace = DynNCAD.Project.NDocument.ModelSpace(nDocument=NDocument)
code_block = CodeBlock { 0.0; 100.0; }
byCoordinates = Point.ByCoordinates(x=code_block.out0, y=code_block.out1, z=code_block.out0)
code_block_2 = CodeBlock { "test"; 3.0; 3; 13; 12; 14; 1; 5; 0; 4; 10; 9; 11; 2; 7; 6; 8; }
text = DynNCAD.Objects.Annotation.Text.Text(block=modelSpace, insetion_point=byCoordinates, text_height=code_block_2.out1, text=code_block_2.out0)
height = DynNCAD.Objects.Annotation.Text.Height(text=text)
rotation = DynNCAD.Objects.Annotation.Text.Rotation(text=text)
scaleFactor = DynNCAD.Objects.Annotation.Text.ScaleFactor(text=text)
styleName = DynNCAD.Objects.Annotation.Text.StyleName(text=text)
textString = DynNCAD.Objects.Annotation.Text.TextString(text=text)
text_2 = DynNCAD.Objects.Annotation.Text.Text()  # unwired: model_object
getSelectedObjects = DynNCAD.Project.NDocument.GetSelectedObjects(nDocument=NDocument)
