# Dynamo graph Test_getObjects.dyn (Dynamo 2.12.1.8246)

# group: Получение сущностей файла
application = DynNCAD.Project.Application.Application()
NDocument = DynNCAD.Project.NDocument.NDocument(ncad_app=application)
autoCADObjectsClasses = DynNCAD.Project.Selection.AutoCADObjectsClasses()
list_create = List.Create(item0=autoCADObjectsClasses.Полилиния)
getSelectedObjectsInDrawing = DynNCAD.Project.Selection.GetSelectedObjectsInDrawing(NDocument=NDocument, classes_names=list_create)
code_block = CodeBlock { null; }

# group: Проверка текста
objectID = DynNCAD.Objects.AcadEntity.ObjectID(acadEntity=getSelectedObjectsInDrawing)
asCOM_object = DynNCAD.Objects.AcadEntity.AsCOM_object(acadEntity=getSelectedObjectsInDrawing)  # frozen
text = DynNCAD.Objects.Annotation.Text.Text(AcadEntity=asCOM_object)
height = DynNCAD.Objects.Annotation.Text.Height(text=text)
textString = DynNCAD.Objects.Annotation.Text.TextString(text=text)

database = DynNCAD.Project.Database.Database(NDocument=NDocument)
modelSpace = DynNCAD.Project.Database.ModelSpace(database=database)
getBlockEntities = DynNCAD.Project.Selection.GetBlockEntities(Block=modelSpace)

# group: Подсчет уникальных значений
objectName = DynNCAD.Objects.AcadEntity.ObjectName(acadEntity=getBlockEntities)
uniqueItems = List.UniqueItems(list=objectName)
подсчет_числа_элементов_классов = Python(IN[0]=objectName, IN[1]=uniqueItems)  # CPython3
# ---------- подсчет_числа_элементов_классов.python (6 lines) ----------
source_list = IN[0]
uniq_values = IN[1]
out_data = dict()
for uniq in uniq_values:
	out_data[uniq] = source_list.count(uniq)
OUT = out_data
# ----------------------------------------

# group: Проверка полилиния
acLwPolyline = DynNCAD.Objects.Geometry.AcLwPolyline.AcLwPolyline(AcadEntity=getSelectedObjectsInDrawing)  # frozen
coordinates = DynNCAD.Objects.Geometry.AcLwPolyline.Coordinates(acLwPolyline=acLwPolyline)
byPoints = PolyCurve.ByPoints(points=coordinates)

getLayers = DynNCAD.Project.Database.GetLayers(database=database)
name = DynNCAD.Project.Layer.Name(layer=getLayers)
