# Dynamo graph demo_Наследование.dyn (Dynamo 2.12.1.8246)

code_block = CodeBlock { "AutoCAD.Application.24"; }

# group: Получение документа
application = DynNCAD.NanoCAD.Application.Application(type=code_block)
document = DynNCAD.NanoCAD.Document.Document(Application=application)

# group: Выборка Текста
autoCADObjectsClasses = DynNCAD.Selection.AutoCADObjectsClasses()
code_block_2 = CodeBlock(b=autoCADObjectsClasses.Текст) { a = [b]; b; }
getSelectedObjectsInDrawing = DynNCAD.Selection.GetSelectedObjectsInDrawing(Document=document, classes_names=code_block_2.b)

# group: Приведение к Тексту
acadText = DynNCAD.AcadObjects.AcadEntities.AcadText.AcadText(AcadEntity=getSelectedObjectsInDrawing)
textString = DynNCAD.AcadObjects.AcadEntities.AcadText.TextString(acadText=acadText)

# group: dynamic :AcadEntity
acadEntity = DynNCAD.AcadObjects.AcadEntity.AcadEntity(sub_class=acadText)
entityName = DynNCAD.AcadObjects.AcadEntity.EntityName(acadEntity=acadEntity)

# group: dynamic :AcadObject
acadObject = DynNCAD.AcadObject.AcadObject(entity=acadEntity)
objectID = DynNCAD.AcadObject.ObjectID(acadObject=acadObject)

layer = DynNCAD.AcadObjects.AcadEntity.Layer(acadEntity=acadEntity)
