# Dynamo graph demo_Получение объектов.dyn (Dynamo 2.12.1.8246)

entityName = DynNCAD.AcadObjects.AcadEntity.EntityName()  # unwired: acadEntity
uniqueItems = List.UniqueItems(list=entityName)
подсчет_числа_элементов_классов = Python(IN[0]=entityName, IN[1]=uniqueItems)  # CPython3
# ---------- подсчет_числа_элементов_классов.python (6 lines) ----------
source_list = IN[0]
uniq_values = IN[1]
out_data = dict()
for uniq in uniq_values:
	out_data[uniq] = source_list.count(uniq)
OUT = out_data
# ----------------------------------------

# group: Получение документа
application = DynNCAD.NanoCAD.Application.Application()
document = DynNCAD.NanoCAD.Document.Document(Application=application)

acadDatabase = DynNCAD.AcadDatabase.AcadDatabase(Document=document)
modelSpace = DynNCAD.AcadDatabase.ModelSpace(acadDatabase=acadDatabase)
