# Dynamo graph demo_Создание геометрии.dyn (Dynamo 2.12.1.8246)

# group: Получение документа
application = DynNCAD.NanoCAD.Application.Application()
document = DynNCAD.NanoCAD.Document.Document(Application=application)

# group: Получение пространства модели
acadDatabase = DynNCAD.AcadDatabase.AcadDatabase(Document=document)
modelSpace = DynNCAD.AcadDatabase.ModelSpace(acadDatabase=acadDatabase)

# group: Получение точки вставки из пространства модели
autoCADObjectsClasses = DynNCAD.Selection.AutoCADObjectsClasses()
code_block = CodeBlock(b=autoCADObjectsClasses.Точка) { a=[b]; b; }
getSelectedObjectsInDrawing = DynNCAD.Selection.GetSelectedObjectsInDrawing(Document=document, classes_names=code_block.a)
acadPoint = DynNCAD.AcadObjects.AcadEntities.AcadPoint.AcadPoint(AcadEntity=getSelectedObjectsInDrawing)
coordinates = DynNCAD.AcadObjects.AcadEntities.AcadPoint.Coordinates(acadPoint=acadPoint)

# group: Параметры создания текста
code_block_2 = CodeBlock { "Это ванная"; 3; }
acadText = DynNCAD.AcadObjects.AcadEntities.AcadText.AcadText(block=modelSpace, insetion_point=coordinates, text_height=code_block_2.out1, text=code_block_2.out0)

# group: Разворот созданного текста
code_block_3 = CodeBlock { 30/180*Math.PI; }
setRotation = DynNCAD.AcadObjects.AcadEntities.AcadText.SetRotation(acadText=acadText, angle=code_block_3)
