# Dynamo graph demo_Таблица.dyn (Dynamo 2.12.1.8246)

# group: Получение пространства модели
application = DynNCAD.NanoCAD.Application.Application()
document = DynNCAD.NanoCAD.Document.Document(Application=application)
acadDatabase = DynNCAD.AcadDatabase.AcadDatabase(Document=document)
modelSpace = DynNCAD.AcadDatabase.ModelSpace(acadDatabase=acadDatabase)

# group: Подсчет числа объектов с сортировкой по их классам
getObjects = DynNCAD.AcadObjects.AcadBlock.GetObjects(acadBlock=modelSpace)
entityName = DynNCAD.AcadObjects.AcadEntity.EntityName(acadEntity=getObjects)
get_count_of_each_class = Python(IN[0]=entityName)  # CPython3
# ---------- get_count_of_each_class.python (6 lines) ----------
source_classes_names = IN[0]
unique = sorted(list(set(source_classes_names)))
frequency = {}
for item in unique:
    frequency[item] = source_classes_names.count(item)
OUT = frequency
# ----------------------------------------

# group: Создание таблицы
code_block = CodeBlock { 367; 420; 0; }
point = DynNCAD.Geometry.Point.Point(x=code_block.out0, y=code_block.out1, z=code_block.out2)
count = DesignScript.Builtin.Dictionary.Count(dictionary=get_count_of_each_class)
for_header_and_columns = CodeBlock(count=count) { count; count + 2; }
column_s_height = CodeBlock { 100; }
acadTable = DynNCAD.AcadObjects.AcadEntities.AcadTable.AcadTable(block=modelSpace, insetion_point=point, rows_count=for_header_and_columns.out1, column_width=column_s_height)

# group: Запись значений в таблицу
write_data = Python(IN[0]=acadTable, IN[1]=get_count_of_each_class)  # IronPython2
# ---------- write_data.python (19 lines) ----------
#Запись данных в таблицу

table = IN[0]
info = IN[1]

com_tanle_instance = table._i

table.SetText(0,0, "Спецификация классов чертежа")
table.SetText(1, 0, "Наименование класса")
table.SetText(1, 1, "Число сущностей, шт.")
counter = 2
for class_name, count_of_items in info.items():
	#обращение к функции класса (к .NET dll)
	table.SetText(counter, 0, class_name)
	#обращение к COM-объекту
	com_tanle_instance.SetText(counter, 1, str(count_of_items))
	counter +=1
OUT = 0
	
# ----------------------------------------

# group: Запись значений таблицы в Excel
directory_path = Directory("E:\Temp")
prepare_data_to_excel = Python(IN[0]=write_data, IN[1]=acadTable, IN[2]=directory_path)  # IronPython2
# ---------- prepare_data_to_excel.python (12 lines) ----------
wait_process = IN[0]
table = IN[1]
path_to_saving = IN[2] + str(r'\table_from_ncad.xlsx')

table_header = table.GetText(0,0)
collection_of_columns_data = list()
for column_counter in range(0, table.Columns_count,1):
	columns_data = []
	for row_counter in range(1, table.Rows_count, 1):
		columns_data.append(table.GetText(row_counter,column_counter))
	collection_of_columns_data.append(columns_data)
OUT = path_to_saving, table_header, collection_of_columns_data
# ----------------------------------------
path = CodeBlock(a=prepare_data_to_excel) { a[0]; }
sheet_name = CodeBlock(a=prepare_data_to_excel) { a[1]; }
code_block_2 = CodeBlock { 0; }
data = CodeBlock(a=prepare_data_to_excel) { a[2]; }

transpose = List.Transpose(lists=data)

# group (continued): Запись значений таблицы в Excel
exportToExcel = Data.ExportToExcel(filePath=path, sheetName=sheet_name, startRow=code_block_2, startColumn=code_block_2, data=transpose)
