# Dynamo graph test_app1.dyn (Dynamo 2.12.1.8246)

application = DynNCAD.App.Application.Application()

# group: Get doc and db
getCOMProcesses = DynNCAD.App.Application.GetCOMProcesses()  # frozen
code_block = CodeBlock(a=getCOMProcesses) { a[14]; }
application_2 = DynNCAD.App.Application.Application(progID=code_block)
document = DynNCAD.App.Document.Document(Application=application)
acadDatabase = DynNCAD.General.AcadDatabase.AcadDatabase(Document=document)

getLayers = DynNCAD.General.AcadDatabase.GetLayers(acadDatabase=acadDatabase)
name = DynNCAD.General.AcadLayer.Name(acadLayer=getLayers)
modelSpace = DynNCAD.General.AcadDatabase.ModelSpace(acadDatabase=acadDatabase)  # frozen
getObjects = DynNCAD.General.AcadBlock.GetObjects(acadBlock=modelSpace)

# group: Выборка опрееленных объектов
entityName = DynNCAD.General.AcadEntity.EntityName(acadEntity=getObjects)
code_block_2 = CodeBlock { "AcDbPolyline"; }
contains = String.Contains(string=entityName, searchFor=code_block_2)
filterByBoolMask = List.FilterByBoolMask(list=getObjects, mask=contains)

# group: Получение внешних ссылок и зависимостей
fileDependencies = DynNCAD.General.AcadDatabase.FileDependencies(acadDatabase=acadDatabase)
feature = DynNCAD.App.AcadFileDependency.Feature(acadFileDependency=fileDependencies)
fileName = DynNCAD.App.AcadFileDependency.FileName(acadFileDependency=fileDependencies)
affectsGraphics = DynNCAD.App.AcadFileDependency.AffectsGraphics(acadFileDependency=fileDependencies)

features = DynNCAD.App.AcadFileDependency.Features()
code_block_3 = CodeBlock { a = [".\\2530-05.dwg",".\\2530-01.dwg"]; }  # frozen
code_block_4 = CodeBlock { false; true; }
acadFileDependency = DynNCAD.App.AcadFileDependency.AcadFileDependency(AcadDatabase=acadDatabase, Feature=features.Внешняя_ссылка, FullFileName=code_block_3, AffectsGraphics=code_block_4.out0, noIncrement=code_block_4.out0)
directory_path = Directory("E:\Temp\files_dwg")
directory_from_path = DirectoryObject(path=directory_path)  # frozen
getDirectoryContents = FileSystem.GetDirectoryContents(directory=directory_from_path)
fullFileName = DynNCAD.App.AcadFileDependency.FullFileName(acadFileDependency=fileDependencies)
foundPath = DynNCAD.App.AcadFileDependency.FoundPath(acadFileDependency=fileDependencies)
